# Grasshopper definition algorithm.gh (Grasshopper 1.0.4)

width = Slider(136, range=130..140)
temple_height = Slider(4, range=0..10)
pd = Slider(68, range=65..70)
bottom_temple = Slider(37.644, range=-1..50)
top_temple = Slider(8.925, range=-1..50)
lens = Geometry(<curve referenced from the Rhino model>)

# ---- group: center lens
connect = ConnectCurves(Curves=lens, Continuity=2, Close=True, Bulge=1)
closed_lens = Geometry(connect)
area = Area(Geometry=closed_lens)  # -> Area, Centroid
centerpoint = Point(area.Centroid)
pdecon = Deconstruct(Point=centerpoint)  # -> XComponent, YComponent, ZComponent
number = Number(-1)
number_2 = Number(-1)
multiplication = Multiplication(A=pdecon.YComponent, B=number)
multiplication_2 = Multiplication(A=number_2, B=pdecon.XComponent)
X = UnitX(Factor=multiplication_2)
Y = UnitY(Factor=multiplication)
move = Move(Geometry=lens, Motion=X)  # -> Geometry, Transform
move_2 = Move(Geometry=move.Geometry, Motion=Y)  # -> Geometry, Transform
centered_lens = Geometry(move_2.Geometry)

# ---- group: create groove
highest_point = Point(Point(0, 70, 0))
crv_cp = CurveClosestPoint(Point=highest_point, Curve=centered_lens)  # -> Point, Parameter, Distance
lens_groove_point_1 = Geometry(crv_cp.Point)
_2 = Number(2)
number_3 = Number(-2)
Z = UnitZ(Factor=_2)
Z_2 = UnitZ(Factor=number_3)
move_3 = Move(Geometry=lens_groove_point_1, Motion=Z_2)  # -> Geometry, Transform
move_4 = Move(Geometry=lens_groove_point_1, Motion=Z)  # -> Geometry, Transform
_0_5 = Number(-0.5)
Y_2 = UnitY(Factor=_0_5)
Y_3 = UnitY(Factor=_0_5)
move_5 = Move(Geometry=move_4.Geometry, Motion=Y_2)  # -> Geometry, Transform
move_6 = Move(Geometry=move_3.Geometry, Motion=Y_3)  # -> Geometry, Transform
lens_groove_point_2 = Geometry(move_6.Geometry)
lens_groove_point_3 = Geometry(move_5.Geometry)
front_thickness = Slider(1.499, range=0.5..2)
polyline = PolyLine(Vertices=[lens_groove_point_2, lens_groove_point_1, lens_groove_point_3], Closed=False)
Y_4 = UnitY(Factor=front_thickness)
extr = Extrude(Base=polyline, Direction=Y_4)
highest_point_2 = Point(Point(0, 0, 23))
lowest_point = Point(Point(0, 0, -20))
groove_line_for_lens = Geometry(extr)
ln = Line(StartPoint=highest_point_2, EndPoint=lowest_point)
railrev = RailRevolution(Curve=groove_line_for_lens, Rail=centered_lens, Axis=ln, Scale=False)
groove_surface = Geometry(railrev)

# ---- group: move groove
_2_2 = Number(2)
division = Division(A=pd, B=_2_2)
X_2 = UnitX(Factor=division)
move_7 = Move(Geometry=groove_surface, Motion=X_2)  # -> Geometry, Transform
right_groove = Geometry(move_7.Geometry)

# ---- group: move curve
_2_3 = Number(2)
division_2 = Division(A=pd, B=_2_3)
X_3 = UnitX(Factor=division_2)
move_8 = Move(Geometry=centered_lens, Motion=X_3)  # -> Geometry, Transform
right_lens = Geometry(move_8.Geometry)

# ---- group: side
division_3 = Division(A=width, B=2)
number_4 = Number(3.25)
Y_5 = UnitY(Factor=temple_height)
division_4 = Division(A=width, B=2)
_0 = Number(0)
_0_2 = Number(0)
_0_3 = Number(0)
pt = ConstructPoint(XCoordinate=division_3, YCoordinate=number_4, ZCoordinate=_0)
pt_2 = ConstructPoint(XCoordinate=division_4, YCoordinate=_0_2, ZCoordinate=_0_3)
move_9 = Move(Geometry=pt, Motion=Y_5)  # -> Geometry, Transform
move_10 = Move(Geometry=pt_2, Motion=Y_5)  # -> Geometry, Transform
top_right_point = Point(move_9.Geometry)
bottom_right_point = Point(move_10.Geometry)

# ---- group: temple
addition = Addition(A=top_temple, B=0.1)
addition_2 = Addition(A=bottom_temple, B=0.1)
eval = EvaluateCurve(Curve=right_lens, Parameter=addition)  # -> Point, Tangent, Angle
eval_2 = EvaluateCurve(Curve=right_lens, Parameter=top_temple)  # -> Point, Tangent, Angle
eval_3 = EvaluateCurve(Curve=right_lens, Parameter=addition_2)  # -> Point, Tangent, Angle
eval_4 = EvaluateCurve(Curve=right_lens, Parameter=bottom_temple)  # -> Point, Tangent, Angle
intcrv = Interpolate(Vertices=[eval_4.Point, eval_3.Point, bottom_right_point], Degree=3, Periodic=False, KnotStyle=1)  # -> Curve, Length, Domain
intcrv_2 = Interpolate(Vertices=[eval.Point, eval_2.Point, top_right_point], Degree=3, Periodic=False, KnotStyle=1)  # -> Curve, Length, Domain
top_temple_2 = Geometry(intcrv_2.Curve)
bottom_temple_2 = Geometry(intcrv.Curve)
