# Grasshopper definition temple.gh (Grasshopper 0.9.80)

temple_height = Slider(5, range=0..10)
thickness = Slider(2, range=2..10)
temple = Geometry(<curve referenced from the Rhino model>)

# ---- group: temple
end = EndPoints(Curve=temple)  # -> Start, End
pt = Point(end.Start)
Y = UnitY(Factor=temple_height)
move = Move(Geometry=pt, Motion=Y)  # -> Geometry, Transform
ln = Line(StartPoint=pt, EndPoint=move.Geometry)
swp1 = Sweep1(Rail=temple, Sections=ln, Miter=1)
Z = UnitZ(Factor=thickness)
extr = Extrude(Base=swp1, Direction=Z)

# ---- group: hinge
end_2 = EndPoints(Curve=temple)  # -> Start, End
pt_2 = Point(end_2.Start)
Y_2 = UnitY(Factor=5)
move_2 = Move(Geometry=pt_2, Motion=Y_2)  # -> Geometry, Transform
ln_2 = Line(StartPoint=pt_2, EndPoint=move_2.Geometry)
Z_2 = UnitZ(Factor=5)
extr_2 = Extrude(Base=ln_2, Direction=Z_2)
X = UnitX(Factor=6.5)
extr_3 = Extrude(Base=extr_2, Direction=X)

# ----
sunion = SolidUnion(Breps=[extr_3, extr])
mirror = Mirror(Geometry=sunion, Plane=PlaneYZ(0, 0, 0))  # -> Geometry, Transform
bake_me = Geometry([mirror.Geometry, sunion])
